# Grasshopper definition calculatePositions.gh (Grasshopper 0.9.70)

divide = DivideCurve(Curve=[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], Count=10, Kinks=False)  # -> Points, Tangents, Parameters
divide_2 = DivideCurve(Curve=[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], Count=9, Kinks=False)  # -> Points, Tangents, Parameters
divide_3 = DivideCurve(Curve=[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], Count=25, Kinks=False)  # -> Points, Tangents, Parameters
panel = Panel("""0
25""")
panel_2 = Panel("""0
9""")
panel_3 = Panel("""0
10""")
cull_i = CullIndex(List=divide_3.Points, Indices=panel, Wrap=False)
cull_i_2 = CullIndex(List=divide_2.Points, Indices=panel_2, Wrap=False)
cull_i_3 = CullIndex(List=divide.Points, Indices=panel_3, Wrap=False)
sph = Sphere(Base=[cull_i, cull_i_2, cull_i_3], Radius=Slider(15, range=0..100))
