# Grasshopper definition dataStructureDevelopment.gh (Grasshopper 0.9.70)

perspexdiameter = Slider(20, range=0..100)
connectionoffset = Slider(30, range=0..100)
perspexthickness = Slider(2, range=0..10)
scalefactor = Slider(2, range=0..10)
lipoffset = Slider(15, range=0..100)
number_slider = Slider(1000, range=0..1000)
vec = VectorXYZ(XComponent=1, YComponent=1, ZComponent=1)  # -> unitize(Vector), Length
multiplication = Multiplication(A=perspexthickness, B="2")
addition = Addition(A=connectionoffset, B=lipoffset)
multiplication_2 = Multiplication(A=vec.Vector)
division = Division(A=number_slider, B=scalefactor)
innerperspexdiameter = Subtraction(A=perspexdiameter, B=multiplication)
multiplication_3 = Multiplication(A=multiplication_2, B=2)
box = CenterBox(Base=PlaneXY(0, 0, 0), X=expr("x/2", number_slider), Y=expr("x/2", number_slider), Z=expr("x/2", number_slider))
box_2 = CenterBox(Base=PlaneXY(0, 0, 0), X=expr("x/2", division), Y=expr("x/2", division), Z=expr("x/2", division))
move = Move(Geometry=box, Motion=multiplication_3)  # -> Geometry, Transform
move_2 = Move(Geometry=box_2, Motion=multiplication_3)  # -> Geometry, Transform
box_corners = BoxCorners(Box=move_2.Geometry)  # -> CornerA, CornerB, CornerC, CornerD, CornerE, CornerF, CornerG, CornerH
box_corners_2 = BoxCorners(Box=move.Geometry)  # -> CornerA, CornerB, CornerC, CornerD, CornerE, CornerF, CornerG, CornerH
move_3 = Move(Geometry=box_2, Motion=multiplication_3)  # -> Geometry, Transform
move_4 = Move(Geometry=box, Motion=multiplication_3)  # -> Geometry, Transform

# ---- group: lines of the cube
outercube = BrepWireframe(Brep=move_4.Geometry, Density=-1)
innercube = BrepWireframe(Brep=move_3.Geometry, Density=-1)
transfer = Line(
    StartPoint=[box_corners_2.CornerA, box_corners_2.CornerB, box_corners_2.CornerC, box_corners_2.CornerD, box_corners_2.CornerE, box_corners_2.CornerF, box_corners_2.CornerG, box_corners_2.CornerH],
    EndPoint=[box_corners.CornerA, box_corners.CornerB, box_corners.CornerC, box_corners.CornerD, box_corners.CornerE, box_corners.CornerF, box_corners.CornerG, box_corners.CornerH])

# ----
panel = Panel([box_corners_2.CornerA, box_corners_2.CornerB, box_corners_2.CornerC, box_corners_2.CornerD, box_corners_2.CornerE, box_corners_2.CornerF, box_corners_2.CornerG, box_corners_2.CornerH])
panel_2 = Panel([box_corners.CornerA, box_corners.CornerB, box_corners.CornerC, box_corners.CornerD, box_corners.CornerE, box_corners.CornerF, box_corners.CornerG, box_corners.CornerH])
end = EndPoints(Curve=outercube)  # -> Start, End
divide = DivideCurve(Curve=innercube, Count=10, Kinks=False)  # -> Points, Tangents, Parameters
divide_2 = DivideCurve(Curve=transfer, Count=9, Kinks=False)  # -> Points, Tangents, Parameters
divide_3 = DivideCurve(Curve=outercube, Count=25, Kinks=False)  # -> Points, Tangents, Parameters
index = ItemIndex(List=flatten(panel), Item=simplify(graft(end.Start)))
panel_3 = Panel("""0
9""")
panel_4 = Panel("""0
25""")
panel_5 = Panel("""0
10""")
panel_6 = Panel(index)
cull_i = CullIndex(List=divide_3.Points, Indices=panel_4, Wrap=False)
cull_i_2 = CullIndex(List=divide_2.Points, Indices=panel_3, Wrap=False)
cull_i_3 = CullIndex(List=divide.Points, Indices=panel_5, Wrap=False)
sph = Sphere(Base=[cull_i, cull_i_2, cull_i_3], Radius=Slider(15, range=0..100))
